# Grasshopper definition cf_import.gh (Grasshopper 1.0.8)
# plug-ins: RhinoCodePluginGH

path = FilePath("D:\04_git\cuttlefish\npy_data\")
panel = Panel(path)
py3 = Python3Script(frame_request=Slider(1, range=1..4), whole_animation=Toggle(False), directory_path=path)  # -> out, elapsed_time, mesh_frames, mesh_frame; inputs frame_request: Int32, whole_animation: Boolean, directory_path: String
#   port frame_request: Frame Index as int
# ---------- py3: Python ----------
import Rhino
import numpy as np
from Grasshopper import DataTree
from Grasshopper.Kernel.Data import GH_Path
import os
import time as t

"""
component inputs(name - type):
    frame_request - int
    whole_animation - bool
    directory_path - File Path (Folder)
    
component outputs(name - type):
    out - terminal, gh specific
    elapsed_time - str
    mesh_frame - Rhino.Geometry.Mesh
    mesh_frames - List of Rhino.Geometry.Mesh
"""

start_time = t.time()

# Match Blender's timeline indexing
frame_request = frame_request - 1

def load_data(file_path, allow_pickle=False):
    return np.load(file_path, allow_pickle=allow_pickle)

def load_vertices(directory_path):
    vert_file = os.path.join(directory_path, "vertices.npy")
    return load_data(vert_file).astype(np.float64)

def load_edges(directory_path):                                 # not in use, keep for later
    edge_file = os.path.join(directory_path, "edges.npy")
    return load_data(edge_file).astype(np.int32)

def load_faces(directory_path):
    face_file = os.path.join(directory_path, "faces.npy")
    faces = load_data(face_file, allow_pickle=True)
    return faces

def create_mesh(vertices, faces):
    mesh = Rhino.Geometry.Mesh()
    
    #Add vertices to the mesh
    for vert in vertices:
        mesh.Vertices.Add(vert[0], vert[1], vert[2])

    for face in faces:
        if isinstance(face, list) and len(face) >= 3:
            mesh.Faces.AddFace(*face)
    return mesh

def process_frames(directory_path, frame_request, whole_animation):
    vertices = load_vertices(directory_path)
    faces = load_faces(directory_path)

    mesh_frames = DataTree[Rhino.Geometry.Mesh]()

    if whole_animation:
        frames = range(vertices.shape[0])
        for frame in frames:
            mesh = create_mesh(vertices[frame], faces[frame])
            mesh_frames.Add(mesh, GH_Path(frame))
        return create_mesh(vertices[frame_request], faces[frame_request]), mesh_frames 
    else:
        return create_mesh(vertices[frame_request], faces[frame_request]), None

mesh_frame, mesh_frames = process_frames(directory_path, frame_request, whole_animation)

end_time = t.time()
elapsed_time = "{} seconds".format(str(round(end_time - start_time, 3)))
# ---------- end py3 ----------
mesh = Mesh(py3.mesh_frames)
mesh_2 = Mesh(py3.mesh_frame)
branch = TreeBranch(Tree=py3.mesh_frames, Path=Slider(0, range=0..3), MaintainPaths=True)
panel_2 = Panel(py3.elapsed_time)
panel_3 = Panel(mesh_2)
panel_4 = Panel(mesh)
